# Grasshopper definition emojis.gh (Grasshopper 0.9.76)

number_slider = Slider(50, range=0..100)
geo = Geometry([<curve referenced from the Rhino model> x6])
geo_2 = Geometry([<curve referenced from the Rhino model> x6])
geo_3 = Geometry([<curve referenced from the Rhino model> x6])
geo_4 = Geometry([<curve referenced from the Rhino model> x6])
geo_5 = Geometry([<curve referenced from the Rhino model> x6])
pt = ConstructPoint(XCoordinate=0, YCoordinate=0, ZCoordinate=0)
cluster = Cluster(B=pt, N=number_slider, geo=geo_5)  # -> V, P
end = EndPoints(Curve=geo)  # -> Start, End
hframe = HorizontalFrame(Curve=reparameterize(geo), Parameter=Slider(0, range=0..100))
deplane = DeconstructPlane(Plane=hframe)  # -> Origin, XAxis, YAxis, ZAxis
cluster_2 = Cluster(B=pt, N=number_slider, geo=geo_2)  # -> V, P
cluster_3 = Cluster(B=pt, N=number_slider, geo=geo)  # -> V, P
geo_6 = Geometry(cluster_3.V)
cluster_4 = Cluster(B=pt, N=number_slider, geo=geo_4)  # -> V, P
cluster_5 = Cluster(B=pt, N=number_slider, geo=geo_3)  # -> V, P
line = LineSDL(Start=deplane.Origin, Direction=deplane.XAxis, Length=Slider(20, range=0..100))
end_2 = EndPoints(Curve=geo_6)  # -> Start, End
geo_7 = Geometry(cluster_4.P)
geo_8 = Geometry(cluster_5.P)
geo_9 = Geometry(cluster_3.P)
geo_10 = Geometry(cluster_2.P)
number_slider_2 = Slider(0, range=0..1)
crv_cp = CurveClosestPoint(Point=end_2.Start, Curve=cluster_2.V)  # -> Point, Parameter, Distance
seam = Seam(Curve=cluster_2.V, Seam=crv_cp.Parameter)
divide = DivideCurve(Curve=seam, Count=number_slider, Kinks=False)  # -> Points, Tangents, Parameters
ln = Line(StartPoint=geo_9, EndPoint=geo_10)
ln_2 = Line(StartPoint=geo_8, EndPoint=geo_7)
cluster_6 = Cluster_2(num=number_slider_2, C=ln)  # -> C_2, swatch, G, item_4
cluster_7 = Cluster_2(num=number_slider_2, C=ln_2)  # -> C_2, swatch, G, item_4
num = Number(number_slider_2)
eval = EvaluateLength(Curve=ln, Length=num, Normalized=True)  # -> Point, Tangent, Parameter
preview = CustomPreview(Geometry=cluster_6.G, Shader=cluster_6.swatch)
preview_2 = CustomPreview(Geometry=cluster_6.item_4, Shader=cluster_6.C_2)
preview_3 = CustomPreview(Geometry=cluster_7.G, Shader=cluster_7.swatch)
preview_4 = CustomPreview(Geometry=cluster_7.item_4, Shader=cluster_7.C_2)
pline = PolyLine(Vertices=eval.Point, Closed=True)
boundary = BoundarySurfaces(Edges=pline)
argb = SplitARGB(Colour=ColourSwatch(SwatchColor=RGB(0, 93, 255)))  # -> Alpha, Red, Green, Blue
argb_2 = SplitARGB(Colour=ColourSwatch(SwatchColor=RGB(255, 238, 0)))  # -> Alpha, Red, Green, Blue
item = ListItem(List=flatten(boundary), Index=0, Wrap=True)  # -> Item, Item1, Item2, Item3, Item4, Item5
number_slider_3 = Slider(255, range=0..1000)
dom = ConstructDomain(DomainStart=argb_2.Green, DomainEnd=argb.Green)
dom_2 = ConstructDomain(DomainStart=argb_2.Red, DomainEnd=argb.Red)
dom_3 = ConstructDomain(DomainStart=argb_2.Blue, DomainEnd=argb.Blue)
geo_11 = Geometry([item.Item, item.Item2, item.Item3, item.Item5, item.Item1])
Z = UnitZ(Factor=1)
remap = RemapNumbers(Value=num, Source=Domain(0, 1), Target=dom_3)  # -> Mapped, Clipped
remap_2 = RemapNumbers(Value=num, Source=Domain(0, 1), Target=dom_2)  # -> Mapped, Clipped
remap_3 = RemapNumbers(Value=num, Source=Domain(0, 1), Target=dom)  # -> Mapped, Clipped
move = Move(Geometry=geo_11, Motion=Z)  # -> Geometry, Transform
cluster_8 = Cluster_3(geo=geo_9)
cluster_9 = Cluster_3(geo=cluster.P)
cluster_10 = Cluster_3(geo=geo_7)
cluster_11 = Cluster_3(geo=geo_10)
multiplication = Multiplication(A=remap_2.Mapped, B=number_slider_3)
cluster_12 = Cluster_3(geo=geo_8)
multiplication_2 = Multiplication(A=remap.Mapped, B=number_slider_3)
multiplication_3 = Multiplication(A=remap_3.Mapped, B=number_slider_3)
panel = Panel(cluster_9)
panel_2 = Panel(cluster_10)
panel_3 = Panel(cluster_11)
panel_4 = Panel(cluster_12)
panel_5 = Panel(cluster_8)
rgb = ColourRGB(Alpha=255, Red=multiplication, Green=multiplication_3, Blue=multiplication_2)
preview_5 = CustomPreview(Geometry=move.Geometry, Shader=ColourSwatch(SwatchColor=RGB(0, 0, 0)))
preview_6 = CustomPreview(Geometry=item.Item4, Shader=rgb)
concat = Concatenate(FragmentA="\"anger\":", FragmentB=cluster_10)
concat_2 = Concatenate(FragmentA="\"joy\":", FragmentB=cluster_8)
concat_3 = Concatenate(FragmentA="\"fear\":", FragmentB=cluster_9)
concat_4 = Concatenate(FragmentA="\"disgust\":", FragmentB=cluster_12)
concat_5 = Concatenate(FragmentA="\"sadness\":", FragmentB=cluster_11)
merge = Merge(Data1=concat_2, Data2=concat_5, Data3=concat_4, Data4=concat, Data5=concat_3)
join = TextJoin(Text=merge, Join=",")
concat_6 = Concatenate(FragmentA="{", FragmentB=join)
concat_7 = Concatenate(FragmentA=concat_6, FragmentB="}")
panel_6 = Panel(concat_7)

# ==== cluster Cluster
geo = ClusterInput()
geo_2 = Geometry(geo)
bbox = BoundingBox(Content=geo_2, Plane=PlaneXY(0, 0, 0), UnionBox=True)  # -> Box, Box_2
area = Area(Geometry=bbox.Box)  # -> Area, Centroid
B = ClusterInput()
vec2pt = Vector2Pt(PointA=area.Centroid, PointB=B, Unitize=False)  # -> Vector, Length
objatts = ObjectAttributes(ObjectOrAttributes=geo_2)  # -> Name, LayerName, LayerFullPath, Color, MaterialName, LinetypeName, GroupIndices, PlotWeight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
move = Move(Geometry=geo_2, Motion=vec2pt.Vector)  # -> Geometry, Transform
tsort = SortText(Keys=objatts.LayerName, Values=move.Geometry, Culture=127)  # -> Keys, Values
N = ClusterInput()
divide = DivideCurve(Curve=tsort.Values, Count=N, Kinks=False)  # -> Points, Tangents, Parameters
V = ClusterOutput(tsort.Values)
P = ClusterOutput(divide.Points)

# ==== cluster Cluster_2
num = ClusterInput()
C = ClusterInput()
num_2 = Number(num)
eval = EvaluateLength(Curve=C, Length=num_2, Normalized=True)  # -> Point, Tangent, Parameter
pline = PolyLine(Vertices=eval.Point, Closed=True)
boundary = BoundarySurfaces(Edges=pline)
area = Area(Geometry=boundary)  # -> Area, Centroid
sort = SortList(Keys=area.Area, ValuesA=boundary)  # -> Keys, ValuesA
item = ListItem(List=reverse(sort.ValuesA), Index=0, Wrap=True)
argb = SplitARGB(Colour=ColourSwatch(SwatchColor=RGB(0, 93, 255)))  # -> Alpha, Red, Green, Blue
swatch = ClusterOutput(ColourSwatch(SwatchColor=RGB(0, 0, 0)))
argb_2 = SplitARGB(Colour=ColourSwatch(SwatchColor=RGB(255, 238, 0)))  # -> Alpha, Red, Green, Blue
area_2 = Area(Geometry=item)  # -> Area, Centroid
item_2 = ListItem(List=flatten(item), Index=0, Wrap=True)  # -> Item, Item1, Item2, Item3, Item4, Item5
number_slider = Slider(255, range=0..1000)
dom = ConstructDomain(DomainStart=argb_2.Green, DomainEnd=argb.Green)
dom_2 = ConstructDomain(DomainStart=argb_2.Red, DomainEnd=argb.Red)
dom_3 = ConstructDomain(DomainStart=argb_2.Blue, DomainEnd=argb.Blue)
sort_2 = SortList(Keys=flatten(area_2.Area), ValuesA=flatten(item))  # -> Keys, ValuesA
item_4 = ClusterOutput(item_2.Item4)
geo = Geometry([item_2.Item5, item_2.Item3, item_2.Item2, item_2.Item1, item_2.Item])
Z = UnitZ(Factor=1)
remap = RemapNumbers(Value=num_2, Source=Domain(0, 1), Target=dom_3)  # -> Mapped, Clipped
remap_2 = RemapNumbers(Value=num_2, Source=Domain(0, 1), Target=dom_2)  # -> Mapped, Clipped
remap_3 = RemapNumbers(Value=num_2, Source=Domain(0, 1), Target=dom)  # -> Mapped, Clipped
move = Move(Geometry=geo, Motion=Z)  # -> Geometry, Transform
multiplication = Multiplication(A=remap_2.Mapped, B=number_slider)
multiplication_2 = Multiplication(A=remap.Mapped, B=number_slider)
multiplication_3 = Multiplication(A=remap_3.Mapped, B=number_slider)
G = ClusterOutput(move.Geometry)
rgb = ColourRGB(Alpha=255, Red=multiplication, Green=multiplication_3, Blue=multiplication_2)
C_2 = ClusterOutput(rgb)

# ==== cluster Cluster_3
geo = ClusterInput()
geo_2 = Geometry(geo)
pdecon = Deconstruct(Point=geo_2)  # -> XComponent, YComponent, ZComponent
bbox = BoundingBox(Content=flatten(geo_2), Plane=PlaneXY(0, 0, 0), UnionBox=True)  # -> Box, Box_2
debrep = DeconstructBrep(Brep=bbox.Box)  # -> Faces, Edges, Vertices
item = ListItem(List=debrep.Vertices, Index=0, Wrap=True)  # -> Item, Item1, Item2, Item3
panel = Panel(""""x": 
"y": """)
pdecon_2 = Deconstruct(Point=item.Item)  # -> XComponent, YComponent, ZComponent
pdecon_3 = Deconstruct(Point=item.Item1)  # -> XComponent, YComponent, ZComponent
pdecon_4 = Deconstruct(Point=item.Item2)  # -> XComponent, YComponent, ZComponent
dom = ConstructDomain(DomainStart=pdecon_2.XComponent, DomainEnd=pdecon_3.XComponent)
dom_2 = ConstructDomain(DomainStart=pdecon_3.YComponent, DomainEnd=pdecon_4.YComponent)
dom_3 = ConstructDomain(DomainStart=0, DomainEnd=1)
remap = RemapNumbers(Value=pdecon.YComponent, Source=dom_2, Target=dom_3)  # -> Mapped, Clipped
remap_2 = RemapNumbers(Value=pdecon.XComponent, Source=dom, Target=dom_3)  # -> Mapped, Clipped
weave = Weave(Pattern=[0, 1], Stream0=remap_2.Mapped, Stream1=remap.Mapped, NullGaps=False)
partition = PartitionList(List=weave, Size=Slider(2, range=0..10))
concat = Concatenate(FragmentA=panel, FragmentB=partition)
panel_2 = Panel(concat)
join = TextJoin(Text=concat, Join=",")
concat_2 = Concatenate(FragmentA="{", FragmentB=join)
concat_3 = Concatenate(FragmentA=concat_2, FragmentB="}")
pshift = ShiftPaths(Data=concat_3, Offset=-1)
panel_3 = Panel(""""lb":
"rb":
"le":
"re":
"head":
"mouth":""")
join_2 = TextJoin(Text=pshift, Join=",")  # -> flatten(Result)
concat_4 = Concatenate(FragmentA=join_2, FragmentB="]")
concat_5 = Concatenate(FragmentA="[", FragmentB=concat_4)
concat_6 = Concatenate(FragmentA=panel_3, FragmentB=concat_5)
join_3 = TextJoin(Text=concat_6, Join=",")
concat_7 = Concatenate(FragmentA="{", FragmentB=join_3)
concat_8 = Concatenate(FragmentA=concat_7, FragmentB="}")
R = ClusterOutput(concat_8)
